# Grasshopper definition viz_stiffness_checker_search_history.ghx (Grasshopper 1.0.7)
# plug-ins: karambaGH

show_removed_elements = BooleanToggle(False)
show_printed_elements = BooleanToggle(True)
panel = Panel("voronoi_S1_03-14-2019_w_layer_log_regression-stiffness-compliance.json")
panel_2 = Panel("voronoi_S1_03-14-2019_w_layer_log_regression-stiffness-nodal_translation.json")
construct_path = ConstructPath(Indices=Slider(280, range=1..400))
python = PythonScript()  # -> rhino_doc_dir, extrusion_instance_dir, extrusion_plan_dir, extrusion_log_dir
# ---------- python: Python ----------
import scriptcontext as sc
from os import path

rhino_doc_dir = path.abspath(path.dirname(sc.doc.Path))
extrusion_instance_dir = path.join(rhino_doc_dir, '..', '..', \
    'assembly_instances', 'extrusion')
extrusion_plan_dir = path.join(rhino_doc_dir, '..', 'extrusion_results')
extrusion_log_dir = path.join(rhino_doc_dir, '..', 'extrusion_log')
# ---------- end python ----------

# ---- group: load log json
panel_3 = Panel("voronoi_S1_03-14-2019_w_layer_log_regression-z.json")
concatenate = Concatenate(Fragment_A=python.extrusion_log_dir, A="\", Fragment_B=panel_2)
ghpython_script = GhPythonScript(seq_result_file_path=concatenate)  # -> out, total_queue_len, removed_elements_tree, queue_ids_tree, queue_scores_tree, backtracks
# ---------- ghpython_script: Python ----------
import rhinoscriptsyntax as rs
import Grasshopper.DataTree as datatree
import Grasshopper.Kernel.Data.GH_Path as ghpath
import System

import json

with open(seq_result_file_path, 'r') as f:
    json_data = json.loads(f.read())

print('computed time: {}'.format(json_data['write_time']))
print('search method: {}'.format(json_data['search_method']))
print('heuristic: {}'.format(json_data['heuristic']))
print('stiffness criteria: {}'.format(json_data['stiffness_criteria']))
print('max_time: {}'.format(json_data['max_time']))
print('max_backtrack: {}'.format(json_data['max_backtrack']))

search_log_data = json_data['search_log']

def priority_composite(p):
    return 100 * p[0] + 100 * abs(p[1]) + p[0]

# each data tree branch represents a search iteration
# - element ids on the queue in ascending order
# - score
queue_ids_tree = datatree[System.Object]()
queue_scores_tree = datatree[System.Object]()
removed_elements_tree = datatree[System.Object]()
total_queue_len = []
removed_elements = []
backtracks = []

for iter_data in search_log_data:
    iter = iter_data['iter']
    removed_elements.append(iter_data['chosen_id'])
    removed_elements_tree.AddRange(removed_elements, ghpath(iter))
    total_queue_len.append(iter_data['total_q_len'])
    backtracks.append(iter_data['backtrack'])
    
    queue_ids = [cand[0] for cand in iter_data['queue']]
    queue_scores = [priority_composite(cand[1]) for cand in iter_data['queue']]
    
    # normalization
    max_s = max(queue_scores)
    min_s = min(queue_scores)
    queue_scores = [(s - min_s) / (max_s - min_s) for s in queue_scores]
    
    queue_ids_tree.AddRange(queue_ids, ghpath(iter))
    queue_scores_tree.AddRange(queue_scores, ghpath(iter))
# ---------- end ghpython_script ----------

# ---- group: load plan json
concatenate_2 = Concatenate(Fragment_A=python.extrusion_plan_dir, A="\", Fragment_B="voronoi_solution_regression-z.json")
ghpython_script_2 = GhPythonScript(seq_result_file_path=concatenate_2)  # -> out, seq_e_ids
# ---------- ghpython_script_2: Python ----------
__author__ = "harry"
__version__ = "2019.08.22"

import rhinoscriptsyntax as rs
import json

with open(seq_result_file_path, 'r') as f:
    json_data = json.loads(f.read())

seq_e_ids = json_data['plan']
del json_data['plan']
print(json_data)
# ---------- end ghpython_script_2 ----------

# ---- group: queue e_ids
tree_branch = TreeBranch(Tree=ghpython_script.queue_ids_tree, Path=construct_path, MaintainPaths=True)

# ---- group: queue score
tree_branch_2 = TreeBranch(Tree=ghpython_script.queue_scores_tree, Path=construct_path, MaintainPaths=True)

# ----
panel_4 = Panel(tree_branch_2)
concatenate_3 = Concatenate(Fragment_A=python.extrusion_instance_dir, A="\", Fragment_B="voronoi_S1_03-14-2019_w_layer.json")
integer = Integer(ghpython_script.backtracks)
number_slider = Slider(255, range=0..255)
panel_5 = Panel(integer)
subtraction = Subtraction(A="1", B=tree_branch_2)
panel_6 = Panel(ghpython_script.out)
multiplication = Multiplication(A=tree_branch_2, B=number_slider)
multiplication_2 = Multiplication(A=subtraction, B=number_slider)

# ---- group: small -> big : red -> blue
colour_rgb = ColourRGB(Alpha=255, Red=multiplication_2, Green=0, Blue=multiplication)

# ---- group: plan sequence e_ids
integer_2 = Integer(reverse(ghpython_script_2.seq_e_ids))

# ---- group: removed element ids
integer_3 = Integer(ghpython_script.removed_elements_tree)
tree_branch_3 = TreeBranch(Tree=integer_3, Path=construct_path, MaintainPaths=True)

# ----
integer_4 = Integer(tree_branch_3)
set_difference = SetDifference(SetA=tree_branch, SetB=integer_4)

# ----
# existing element ids
integer_5 = Integer()

material_properties_karamba3d = MaterialPropertiesKaramba3D(
    FamilyOfMaterial="Steel",
    Name="S235",
    YoungsModulus_kN_cm2=21000,
    InPlaneShearModulus_kN_cm2=8076,
    TransverseShearModulus_kN_cm2=8076,
    SpecificWeight_kN_m3=78.5,
    CoefficientOfThermalExpansion_1_C=1e-05,
    YieldStrength_kN_cm2=23.5,
    mode="Isotrop")
cluster = Cluster_5(frame_json_file_path=concatenate_3, scale=Slider(1, range=0..1000))  # -> all_nodes, all_elements, all_element_node_ids, all_fix_node_ids, material, radius
panel_7 = Panel(cluster.material)
panel_8 = Panel(material_properties_karamba3d)
ghpython_script_3 = GhPythonScript(existing_e_ids=integer_5, all_element_node_ids=cluster.all_element_node_ids, all_fix_node_ids=cluster.all_fix_node_ids)  # -> out, exist_fix_node_ids; inputs existing_e_ids: list of Int32, all_element_node_ids: tree of Int32, all_fix_node_ids: list of Int32
# ---------- ghpython_script_3: Python ----------
from ghpythonlib.treehelpers import list_to_tree, tree_to_list

element_vids = tree_to_list(all_element_node_ids, lambda x : x)
existing_e_ids = existing_e_ids or list(range(len(element_vids)))

existing_node_ids = set()
for e_id, e_tuple in enumerate(element_vids):
    if e_id in existing_e_ids:
        existing_node_ids.update(e_tuple)

print(all_fix_node_ids)

exist_fix_node_ids = [int(v) for v in all_fix_node_ids if v in existing_node_ids]

#existing_elements = datatree[System.Object]()
#for e_id in existing_ids:
#    existing_elements.Add(rg.Line(all_nodes[element_vids[e_id][0]], all_nodes[element_vids[e_id][1]]), ghpath(e_id))
#
#existing_nodes = datatree[System.Object]()
#for n_id in existing_node_ids:
#    existing_nodes.Add(all_nodes[n_id], ghpath(n_id))
# ---------- end ghpython_script_3 ----------

# ---- group: all nodes & elements
curve = Curve(cluster.all_elements)
point = Point(cluster.all_nodes)

# ---- group: highlight queue candidate elements
integer_6 = Integer(set_difference)
list_item = ListItem(List=curve, Index=integer_6, Wrap=False)
pipe = Pipe(Curve=list_item, Radius=Slider(0.002, range=0..0.005), Caps=0)  # -> flatten(Pipe)
# small compliance (red) means removing it has
# little impact on the structure
# 
# large compliance (blue) means removing it has
# a large impact on the structure
custom_preview = CustomPreview(Geometry=pipe, Material=colour_rgb)

# ----
list_item_2 = ListItem(List=curve, Index=integer_5, Wrap=True)
curve_2 = Curve(curve)
integer_7 = Integer(tree_branch_3)
curve_3 = Curve(list_item_2)
end_points = EndPoints(Curve=curve_3)  # -> Start, End
point_2 = Point([end_points.Start, end_points.End])

# ---- group: highlight removed elements
list_item_3 = ListItem(List=curve_2, Index=integer_7, Wrap=True)
colour_cmyk = ColourCMYK(Cyan=Slider(1, range=0..1), Magenta=0, Yellow=0, Key=0)
pipe_2 = Pipe(Curve=list_item_3, Radius=Slider(0.002, range=0..0.005), Caps=0)
stream_filter = StreamFilter(Gate=show_removed_elements, Stream1=pipe_2)
custom_preview_2 = CustomPreview(Geometry=stream_filter, Material=colour_cmyk)

# ---- group: highlight printed elements
list_length = ListLength(List=curve_2)
ghpython_script_4 = GhPythonScript(x=list_length)  # -> out, a; inputs x: Int32
# ---------- ghpython_script_4: Python ----------
a = list(range(x))
# ---------- end ghpython_script_4 ----------
set_difference_2 = SetDifference(SetA=ghpython_script_4.a, SetB=integer_7)
list_item_4 = ListItem(List=curve_2, Index=set_difference_2, Wrap=True)
stream_filter_2 = StreamFilter(Gate=show_printed_elements, Stream1=list_item_4)

# ----
remove_duplicate_points_karamba3d = RemoveDuplicatePointsKaramba3D(Point=point_2, LimitDistance=0.005)  # -> OutPoint, Info, Indexes
point_3 = Point(remove_duplicate_points_karamba3d.OutPoint)
integer_8 = Integer(ghpython_script_3.exist_fix_node_ids)

# ----
# all nodes
point_4 = Point(point)

list_item_5 = ListItem(List=point_4, Index=integer_8, Wrap=True)

# ----
# existing nodes
point_5 = Point(flatten(point_3))

# ----
# existing elements
curve_4 = Curve(flatten(curve_3))

# ----
# grounded nodes
point_6 = Point(list_item_5)

cluster_2 = Cluster_3(model=curve_4)
point_7 = Point(point_5)
cluster_3 = Cluster_4(pts=point_7, target_pts=point_6, list=point_7)
curve_5 = Curve(curve)
point_8 = Point(point)
integer_9 = Integer(cluster.all_fix_node_ids)
list_item_6 = ListItem(List=point_8, Index=integer_9, Wrap=True)
curve_6 = Curve(curve_4)
number = Number(cluster.radius)
curve_7 = Curve(curve_5)
number_2 = Number(cluster.radius)
cluster_4 = Cluster_2(point=list_item_6, point_2=point_8, line=curve_7, material=cluster.material, thickness=number)  # -> result, data, result_2, keys, elastic_energy_knm, calculated_model; disabled
cluster_5 = Cluster_2(point=point_6, point_2=point_7, line=curve_6, material=cluster.material, thickness=number)  # -> result, data, result_2, keys, elastic_energy_knm, calculated_model; disabled

partial_structure_compliance = Panel(cluster_5.elastic_energy_knm)
full_structure_compliance = Panel(cluster_4.elastic_energy_knm)
max_deformation_l2_on_trans = Panel(cluster_5.keys)

internal_froce_kn_moment_kn_m = Panel(cluster_5.result)
reaction_force_kn_reaction_moment_kn_m = Panel(cluster_5.result_2)
nodal_displacement_m_rad = Panel(cluster_5.data)

model_view_karamba3d = ModelViewKaramba3D(Model=cluster_5.calculated_model, LoadCaseFactorsForLinearSuperposition=1, IndexOfVisibleLoadcase=-1)  # -> Model, DeformedMesh, DeformedAxes, DeformedModel
beam_view_karamba3d = BeamViewKaramba3D(Model=model_view_karamba3d.Model)  # -> Model, MeshesOfRenderedBeams, DeformedBeamAxes, LegendColors, LegendTags
legend = Legend(Colour=beam_view_karamba3d.LegendColors, Tags=beam_view_karamba3d.LegendTags, LegendType=1)

# ==== cluster Cluster_2
point = ClusterInput()
material = ClusterInput()
thickness = ClusterInput()
line = ClusterInput()
point_2 = ClusterInput()
point_3 = Point(point)
# Gravity load
unit_z = UnitZ(Factor=1)
# Supports
support_karamba3d = SupportKaramba3D(PosInd=point_3, menu=[buttons(on, on, on, on, on, on)])
negative = Negative(Value=unit_z)
multiplication = Multiplication(A=thickness, B="2")
loads_karamba3d = LoadsKaramba3D(Vector=negative, LCase=0, mode="Gravity")
support_karamba3d_2 = SupportKaramba3D(support_karamba3d)
cross_section_karamba3d = CrossSectionKaramba3D(
    FamilyNameOfCrossSection="DefaultCroSec",
    Material=material,
    Diameter_cm=multiplication,
    WallThickness_cm=thickness,
    mode="Circular Hollow")
point_4 = Point(point_2)
line_to_beam_karamba3d = LineToBeamKaramba3D(Line=line, CrossSection=cross_section_karamba3d, Points=point_4, New=True, Remove=True, LimitDistance_m=0.005)  # -> Element, Points, Info
load_karamba3d = LoadKaramba3D(loads_karamba3d)
assemble_model_karamba3d = AssembleModelKaramba3D(
    Point=point_4,
    Elem=line_to_beam_karamba3d.Element,
    Support=support_karamba3d_2,
    Load=load_karamba3d,
    LimitDistance_m=0.005)  # -> Model, Info, Mass_kg, CenterOfGravity
analyze_karamba3d = AnalyzeKaramba3D(Model=assemble_model_karamba3d.Model)  # -> CalculatedModel, MaximumDisplacement_cm, ResultingForceOfGravity_kN, ElasticEnergy_kNm
reaction_forces_karamba3d = ReactionForcesKaramba3D(AnalyzedModel=analyze_karamba3d.CalculatedModel, LoadCase=0)  # -> AnalyzedModel, ReactionForces_kN, ReactionMoments_kNm, SupportPosition, SumOfReactionForces_kN, SumOfReactionMoments_kNm
nodal_displacements_karamba3d = NodalDisplacementsKaramba3D(AnalyzedModel=analyze_karamba3d.CalculatedModel, LoadCase=0)  # -> AnalyzedModel, NodalTranslations_m, NodalRotations_rad
beam_forces_karamba3d = BeamForcesKaramba3D(
    AnalyzedModel=analyze_karamba3d.CalculatedModel,
    LCase=-1,
    MaximumDistanceBetweenResults_m=-1,
    NumberOfResultsPerBeamElement=2)  # -> AnalyzedModel, NormalForce_kN, ShearForceVz_kN, ShearForceVy_kN, BendingMomentMt_kNm, BendingMomentMy_kNm, BendingMomentMz_kNm
deconstruct = Deconstruct(Point=simplify(graft(reaction_forces_karamba3d.ReactionForces_kN)))  # -> XComponent, YComponent, ZComponent
deconstruct_2 = Deconstruct(Point=simplify(graft(reaction_forces_karamba3d.ReactionMoments_kNm)))  # -> XComponent, YComponent, ZComponent
merge = Merge(
    Data1=simplify(graft(nodal_displacements_karamba3d.NodalTranslations_m)),
    Data2=simplify(graft(nodal_displacements_karamba3d.NodalRotations_rad)))
evaluate = Evaluate(Expression="format(\"{0:E} {1:E} {2:E}\",x.x,x.y,x.z)", x=merge)
merge_2 = Merge(
    Data1=deconstruct.XComponent,
    Data2=deconstruct.YComponent,
    Data3=deconstruct.ZComponent,
    Data4=deconstruct_2.XComponent,
    Data5=deconstruct_2.YComponent,
    Data6=deconstruct_2.ZComponent)
merge_3 = Merge(
    Data1=graft(beam_forces_karamba3d.NormalForce_kN),
    Data2=graft(beam_forces_karamba3d.ShearForceVz_kN),
    Data3=graft(beam_forces_karamba3d.ShearForceVy_kN),
    Data4=graft(beam_forces_karamba3d.BendingMomentMt_kNm),
    Data5=graft(beam_forces_karamba3d.BendingMomentMy_kNm),
    Data6=graft(beam_forces_karamba3d.BendingMomentMz_kNm))  # -> simplify(Result)
evaluate_2 = Evaluate(Expression="format(\"{0:E}\",x)", x=merge_2)
cluster = Cluster(text=evaluate, separators=" ")
evaluate_3 = Evaluate(Expression="format(\"{0:E}\",x)", x=merge_3)
reaction_force_kn_reaction_moment_kn_m = Panel(merge_2)
shift_paths = ShiftPaths(Data=cluster, Offset=-1)
list_item = ListItem(List=shift_paths, Index=0, Wrap=True)  # -> Item, Item1, Item2
froce_kn_moment_kn_m = Panel(merge_3)
nodal_displacement_m_rad = Panel(shift_paths)
merge_4 = Merge(Data1=list_item.Item, Data2=list_item.Item1, Data3=list_item.Item2)
number = Number(merge_4)
square = Square(Value=number)
mass_addition = MassAddition(Input=square)  # -> Result, PartialResults
square_root = SquareRoot(Value=mass_addition.Result)  # -> flatten(Result)
sort_list = SortList(Keys=square_root)  # -> reverse(Keys), ValuesValuesA
elastic_energy_knm = ClusterOutput(analyze_karamba3d.ElasticEnergy_kNm)
calculated_model = ClusterOutput(analyze_karamba3d.CalculatedModel)
result = ClusterOutput(merge_3)
data = ClusterOutput(shift_paths)
result_2 = ClusterOutput(merge_2)
keys = ClusterOutput(sort_list.Keys)

# ==== cluster Cluster_3
curve = Curve()
model = ClusterInput()
entwine = Entwine(Branch00=curve, FlattenInputs=True)
# element id shower
c_script = CSharpScript(model=model, layers=entwine)  # -> out, A, edge_layer_list; inputs model: list of Curve, layers: tree of Curve
# ---------- c_script: C# usings ----------
using System.IO;
using System.Linq;
using System.Data;
using System.Drawing;
using System.Reflection;
using System.Windows.Forms;
using System.Xml;
using System.Xml.Linq;
using System.Runtime.InteropServices;

using Rhino.DocObjects;
using Rhino.Collections;
using GH_IO;
using GH_IO.Serialization;
# ---------- c_script: C# ----------
    DataTree<int> index_tree = new DataTree<int>();
    List<int> edge_layer = new List<int>(new int[model.Count()]);

    foreach(var path in layers.Paths)
    {
      foreach(var line in layers.Branch(path.Indices))
      {
        for(int i = 0; i < model.Count(); i++)
        {
          var compare_line = model[i];

          if(line.PointAt(0) == compare_line.PointAt(0))
          {
            if(line.PointAt(1) == compare_line.PointAt(1))
            {
              index_tree.Add(i, path);
              edge_layer[i] = path.Indices[0];
              //              GH_Path p = new GH_Path(0);
              //              p.Indices
              continue;
            }
          }

          if(line.PointAt(0) == compare_line.PointAt(1))
          {
            if(line.PointAt(1) == compare_line.PointAt(0))
            {
              index_tree.Add(i, path);
              edge_layer[i] = path.Indices[0];
              continue;
            }
          }
        }
      }
    }

    A = index_tree;
    edge_layer_list = edge_layer;
# ---------- end c_script ----------
list_item = ListItem(List=model, Index=c_script.A, Wrap=True)
panel = Panel(c_script.A)
ghpython_script = GhPythonScript(x=panel)  # -> out, a; inputs x: list
# ---------- ghpython_script: Python ----------
__author__ = "harry"
__version__ = "2019.08.22"

import rhinoscriptsyntax as rs

print([int(v) for v in x])
# ---------- end ghpython_script ----------

# ==== cluster Cluster_4
pts = ClusterInput()
target_pts = ClusterInput()
c_script = CSharpScript(pts=pts, target_pts=target_pts, dist_tol=0.001)  # -> out, A; inputs pts: list of Point3d, target_pts: list of Point3d, dist_tol: Double; disabled
# ---------- c_script: C# usings ----------
using System.IO;
using System.Linq;
using System.Data;
using System.Drawing;
using System.Reflection;
using System.Windows.Forms;
using System.Xml;
using System.Xml.Linq;
using System.Runtime.InteropServices;

using Rhino.DocObjects;
using Rhino.Collections;
using GH_IO;
using GH_IO.Serialization;
# ---------- c_script: C# ----------
    List<int> id = new List<int>();

    foreach(Point3d t_pt in target_pts)
    {
      for(int i = 0; i < pts.Count(); i++)
      {
        if(t_pt.DistanceTo(pts[i]) < dist_tol)
        {
          id.Add(i);
          break;
        }
      }
    }

    A = id;
# ---------- end c_script ----------
list = ClusterInput()
list_item = ListItem(List=list, Index=c_script.A, Wrap=True)  # disabled

# ==== cluster Cluster_5
frame_json_file_path = ClusterInput()
scale = ClusterInput()
ghpython_script = GhPythonScript(frame_json_file_path=frame_json_file_path, scale=scale)  # -> out, all_nodes, all_elements, simplify(all_element_node_ids), all_fix_node_ids, material_name, E, E_unit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
# ---------- ghpython_script: Python ----------
import rhinoscriptsyntax as rs
import Rhino.Geometry as rg
from Grasshopper import DataTree as datatree
from Grasshopper.Kernel.Data import GH_Path as ghpath
import System
import math

from ghpythonlib.treehelpers import list_to_tree, tree_to_list
from compas.rpc import Proxy
cm = Proxy('pyconmech.frame_analysis.frame_file_io')

def rvector2list(rv):
    return [rv.X, rv.Y, rv.Z]

frame_info = cm.read_frame_json(frame_json_file_path, verbose=True)

node_points, element_vids, fix_node_ids, fix_specs, model_type, material_dicts, model_name = frame_info

all_nodes = [rs.CreatePoint(scale*pt[0], scale*pt[1], scale*pt[2]) for pt in node_points]
all_elements = [rg.Line(all_nodes[n1], all_nodes[n2]) for n1, n2 in element_vids]

all_element_node_ids = list_to_tree(element_vids)
all_fix_node_ids = [int(v) for v in fix_node_ids]

material_name = material_dicts[0]['material_name']
E = material_dicts[0]['youngs_modulus']
E_unit = material_dicts[0]['youngs_modulus_unit']

G = material_dicts[0]['shear_modulus']
G_unit = material_dicts[0]['shear_modulus_unit']

if 'tensile_yeild_stress' in material_dicts[0]:
    sigma = material_dicts[0]['tensile_yeild_stress']
    sigma_unit = material_dicts[0]['tensile_yeild_stress_unit']

rho = material_dicts[0]['density']
rho_unit = material_dicts[0]['density_unit']

r = math.sqrt(material_dicts[0]['cross_sec_area'] / math.pi)
r_unit = 'centimeter'
# ---------- end ghpython_script ----------
data = Data(ghpython_script.G_unit)
data_2 = Data(ghpython_script.material_name)
data_3 = Data(ghpython_script.E)
data_4 = Data(ghpython_script.E_unit)
data_5 = Data(ghpython_script.G)
data_6 = Data(ghpython_script.r)
data_7 = Data(ghpython_script.sigma)
data_8 = Data(ghpython_script.rho)
data_9 = Data(ghpython_script.sigma_unit)
data_10 = Data(ghpython_script.rho_unit)
data_11 = Data(ghpython_script.r_unit)
panel = Panel(data_3)
panel_2 = Panel(data_5)
panel_3 = Panel(data_4)
panel_4 = Panel(data_11)
panel_5 = Panel(data_10)
panel_6 = Panel(data_2)
panel_7 = Panel(data)
panel_8 = Panel(data_7)
panel_9 = Panel(data_8)
panel_10 = Panel(data_9)
panel_11 = Panel(data_6)
material_properties_karamba3d = MaterialPropertiesKaramba3D(
    FamilyOfMaterial=panel_6,
    Name="0",
    YoungsModulus_kN_cm2=panel,
    InPlaneShearModulus_kN_cm2=panel_2,
    TransverseShearModulus_kN_cm2=panel_2,
    SpecificWeight_kN_m3=panel_9,
    CoefficientOfThermalExpansion_1_C=1e-05,
    YieldStrength_kN_cm2=Slider(23.5, range=0..100),
    mode="Isotrop")
all_nodes = ClusterOutput(ghpython_script.all_nodes)
all_element_node_ids = ClusterOutput(ghpython_script.all_element_node_ids)
all_elements = ClusterOutput(ghpython_script.all_elements)
all_fix_node_ids = ClusterOutput(ghpython_script.all_fix_node_ids)
radius = ClusterOutput(panel_11)  # radius
material = ClusterOutput(material_properties_karamba3d)

# ==== cluster Cluster
text = ClusterInput()
separators = ClusterInput()
text_split = TextSplit(Text=text, Separators=separators)
number = Number(text_split)
clean_tree = CleanTree(RemoveNulls=True, RemoveInvalid=True, RemoveEmpty=False, Tree=number)
tree = ClusterOutput(clean_tree)
