# Grasshopper definition viz_stiffness_checker_compliance.ghx (Grasshopper 1.0.7)
# plug-ins: karambaGH

panel = Panel("voronoi_S1_03-14-2019_w_layer.json")
python = PythonScript()  # -> rhino_doc_dir, extrusion_instance_dir, extrusion_plan_dir, extrusion_log_dir
# ---------- python: Python ----------
import scriptcontext as sc
from os import path

rhino_doc_dir = path.abspath(path.dirname(sc.doc.Path))
extrusion_instance_dir = path.join(rhino_doc_dir, '..', '..', \
    'assembly_instances', 'extrusion')
extrusion_plan_dir = path.join(rhino_doc_dir, '..', 'extrusion_results')
extrusion_log_dir = path.join(rhino_doc_dir, '..', 'extrusion_log')
# ---------- end python ----------
panel_2 = Panel(python.extrusion_instance_dir)
concatenate = Concatenate(Fragment_A=python.extrusion_instance_dir, A="\", Fragment_B="topopt-100_S1_03-14-2019_w_layer.json")
material_properties_karamba3d = MaterialPropertiesKaramba3D(
    FamilyOfMaterial="Steel",
    Name="S235",
    YoungsModulus_kN_cm2=21000,
    InPlaneShearModulus_kN_cm2=8076,
    TransverseShearModulus_kN_cm2=8076,
    SpecificWeight_kN_m3=78.5,
    CoefficientOfThermalExpansion_1_C=1e-05,
    YieldStrength_kN_cm2=23.5,
    mode="Isotrop")
cluster = Cluster_3(frame_json_file_path=concatenate, scale=Slider(1, range=0..1000))  # -> all_nodes, all_elements, all_element_node_ids, all_fix_node_ids, material, radius
panel_3 = Panel(material_properties_karamba3d)

# ---- group: all nodes & elements
curve = Curve(cluster.all_elements)
point = Point(cluster.all_nodes)

# ----
panel_4 = Panel(cluster.material)
curve_2 = Curve(reparameterize(curve))
evaluate_curve = EvaluateCurve(Curve=curve_2, Parameter=Slider(0.5, range=0..1))  # -> Point, Tangent, Angle
point_2 = Point(evaluate_curve.Point)

# ----
# z score
deconstruct = Deconstruct(Point=point_2)  # -> XComponent, YComponent, ZComponent
negative = Negative(Value=deconstruct.ZComponent)
# partial compliance
# by removing each element
# in the original e id order
# partial max nodal translation
# by removing each element
# in the original e id order
number = Number(negative)

# ---- group: voronoi
number_2 = Number([1.026627537, 1.002540525, 1.067640559, 1.035741542, 1.010352529, 1.01230553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])

# ---- group: topopt-100 compliance
number_3 = Number([1.056135797, 1.056135797, 1.056135797, 1.056135797, 0.9901273101, 0.9901273101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])

# ---- group: topopt-100 nodal disp
number_4 = Number([5.736234699, 5.736234699, 5.736234699, 5.736234699, 1.008665346, 1.008665346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])

# ---- group: voronoi
number_5 = Number([0.9496257172, 1.036028447, 1.023243225, 0.963421634, 0.9801676688, 0.9920903853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])

# ---- group: z
number_6 = Number(number)

# ----
number_7 = Number(number_3)

# ---- group: full indices
list_length = ListLength(List=curve_2)
series = Series(Start=0, Step=1, Count=list_length)

# ----
multiplication = Multiplication(A=number_7, B=Slider(10, range=0..10))
multiplication_2 = Multiplication(A=number_6, B=Slider(0, range=0..10))
addition = Addition(A=multiplication, B=multiplication_2)
integer = Integer(simplify(graft(series)))
panel_5 = Panel(integer)
integer_2 = Integer(integer)
number_8 = Number(addition)
number_9 = Number()
replace_items = ReplaceItems(List=series, Indices=integer_2, Wrap=False)
list_item = ListItem(List=series, Index=integer_2, Wrap=True)

# ---- group: original ids
integer_3 = Integer(series)

# ---- group: score
number_10 = Number(number_8)

# ----
panel_6 = Panel(integer_2)
clean_tree = CleanTree(RemoveNulls=True, RemoveInvalid=True, RemoveEmpty=False, Tree=replace_items)  # -> simplify(Tree)

# ---- group: orig id -> ordered id
cluster_2 = Cluster_4(integer=integer_3, keys=number_10)

# ---- group: removed element ids
integer_4 = Integer(list_item)

# ----
integer_5 = Integer(clean_tree)

# ---- group: Import remote python modules
panel_7 = Panel("C:\Users\yijiangh\Software\Miniconda\envs\rhinoremote\python.exe")
python_2 = PythonScript()  # -> rhino_doc_dir
# ---------- python_2: Python ----------
import scriptcontext as sc
from os import path

rhino_doc_dir = path.abspath(path.dirname(sc.doc.Path))
# ---------- end python_2 ----------
panel_8 = Panel(python_2)
panel_9 = Panel("""numpy
numpy.linalg
pyconmech""")
list = ValueList({"CRITICAL", "ERROR", "WARNING", "INFO", "DEBUG", "NOTSET"}, selected="DEBUG")
ghpythonremote = GHPythonRemote(location=panel_7, run=Toggle(True), modules=panel_9, log_level=list, working_dir=panel_8)  # -> out, linked_modules, rpy; inputs run: Boolean, modules: list
# ---------- ghpythonremote: Python ----------
import sys
import scriptcontext
import logging
import inspect
import ghpythonremote
from ghpythonremote.connectors import GrasshopperToPythonRemote
from os import path
from time import sleep

local_log_level = getattr(logging, log_level, logging.WARNING)
logger = logging.getLogger('ghpythonremote')
logger.setLevel(local_log_level)
ch = logging.StreamHandler()
ch.setLevel(local_log_level)
formatter = logging.Formatter('%(levelname)s: %(name)s:\n%(message)s')
ch.setFormatter(formatter)
logger.handlers = []
logger.addHandler(ch)
logger = logging.getLogger('ghpythonremote.GH_to_python')

ROOT = path.abspath(path.dirname(inspect.getfile(ghpythonremote)))
rpyc_server_py = path.join(ROOT, 'pythonservice.py')

# Set connection to CLOSED if this is the first run
# and initialize set of linked modules
try:
    remote_python_status
except NameError:
    remote_python_status = 'CLOSED'
    lkd_modules = set()

# Wait for connection to connect or terminate
timer = 0
while remote_python_status == 'CONNECTING' or remote_python_status == 'CLOSING':
    sleep(1)
    timer += 1
    if timer == 10:
        try:
            gh2py_manager.__exit__(*sys.exc_info())
        except Exception:
            pass
        remote_python_status = 'CLOSED'
        lkd_modules = set()
        raise RuntimeError("Connection left in an inconsistent state and not returning. Reset everything.")

if run:
    if not remote_python_status == 'OPEN':
        remote_python_status = 'CONNECTING'
        gh2py_manager = GrasshopperToPythonRemote(rpyc_server_py, location=location, timeout=10,
                                                  port=None, log_level=log_level, working_dir=working_dir)
        gh2py = gh2py_manager.__enter__()
        remote_python_status = 'OPEN'

    # Stuff that we can reach
    rpymod = gh2py.py_remote_modules  # A getter function for a named python module
    rpy = gh2py.connection  # Represents the remote instance root object
    scriptcontext.sticky['rpy'] = rpy
    # Add modules
    for mod in modules:
        try:
            scriptcontext.sticky[mod] = rpymod(mod)
            lkd_modules.add(mod)
        except ImportError:
            gh2py_manager.__exit__(*sys.exc_info())
            raise

elif not remote_python_status == 'CLOSED':
    remote_python_status = 'CLOSING'
    # Remove linked modules
    for mod in lkd_modules:
        del scriptcontext.sticky[mod]
    del scriptcontext.sticky['rpy']
    gh2py_manager.__exit__(*sys.exc_info())
    lkd_modules = set()
    remote_python_status = 'CLOSED'

# Change variable name because ghpython resets outputs to None before each run
linked_modules = lkd_modules

logger.info('GH to python connection is {}'.format(remote_python_status))
# ---------- end ghpythonremote ----------
python_3 = PythonScript(module_names=ghpythonremote.linked_modules)  # -> import_statements; inputs module_names: list
# ---------- python_3: Python ----------
import_statements = ["import scriptcontext as sc"]
for module_name in module_names:
    import_statements.append("{0} = sc.sticky['{0}']".format(module_name))

if len(module_names) == 0:
    import_statements = []
# ---------- end python_3 ----------
panel_10 = Panel(python_3)

# ----
# existing element ids
integer_6 = Integer(integer_5)

text = Text(concatenate)
ghpython_script = GhPythonScript(existing_e_ids=integer_6, all_element_node_ids=cluster.all_element_node_ids, all_fix_node_ids=cluster.all_fix_node_ids)  # -> out, simplify(exist_fix_node_ids); inputs existing_e_ids: list of Int32, all_element_node_ids: tree of Int32, all_fix_node_ids: list of Int32
# ---------- ghpython_script: Python ----------
from ghpythonlib.treehelpers import list_to_tree, tree_to_list

element_vids = tree_to_list(all_element_node_ids, lambda x : x)
existing_e_ids = existing_e_ids or list(range(len(element_vids)))

existing_node_ids = set()
for e_id, e_tuple in enumerate(element_vids):
    if e_id in existing_e_ids:
        existing_node_ids.update(e_tuple)

print(all_fix_node_ids)

exist_fix_node_ids = [int(v) for v in all_fix_node_ids if v in existing_node_ids]

#existing_elements = datatree[System.Object]()
#for e_id in existing_ids:
#    existing_elements.Add(rg.Line(all_nodes[element_vids[e_id][0]], all_nodes[element_vids[e_id][1]]), ghpath(e_id))
#
#existing_nodes = datatree[System.Object]()
#for n_id in existing_node_ids:
#    existing_nodes.Add(all_nodes[n_id], ghpath(n_id))
# ---------- end ghpython_script ----------
list_item_2 = ListItem(List=curve, Index=integer_6, Wrap=True)
integer_7 = Integer(integer_4)
curve_3 = Curve(list_item_2)
curve_4 = Curve(curve)

# ----
# all nodes
point_3 = Point(point)

integer_8 = Integer(ghpython_script.exist_fix_node_ids)
list_item_3 = ListItem(List=point_3, Index=integer_8, Wrap=True)

# ----
# grounded nodes
point_4 = Point(list_item_3)

curve_5 = Curve(curve)
point_5 = Point(point)
integer_9 = Integer(cluster.all_fix_node_ids)
number_slider = Slider(100, range=0..100)
number_11 = Number(number_slider)
ghpython_script_2 = GhPythonScript(extrusion_path=text, gravity_scale=number_11)  # -> out, partial_compliance
# ---------- ghpython_script_2: Python ----------
import os
import scriptcontext as sc
pyconmech = sc.sticky['pyconmech']
np = sc.sticky['numpy']

abs_path = os.path.abspath(extrusion_path)
checker = pyconmech.frame_analysis.stiffness_checker.StiffnessChecker(json_file_path=extrusion_path)

checker.set_loads(include_self_weight=True, gravity_direction=[0, 0, gravity_scale])

TRANS_TOL = 0.005
ROT_TOL = 10 * np.pi / 180
checker.set_nodal_displacement_tol(trans_tol=TRANS_TOL, rot_tol=ROT_TOL)

elements = checker.elements
element_ids = set(range(len(elements)))

partial_compliance = []
for i in list(element_ids):
    extruded_ids = list(element_ids - {i})
    checker.solve(exist_element_ids=extruded_ids)
    partial_compliance.append(checker.get_compliance())
# ---------- end ghpython_script_2 ----------
number_12 = Number(ghpython_script_2.partial_compliance)

# ---- group: conmech computed partial compliance
number_13 = Number(number_12)

# ----
quick_graph = QuickGraph(number_12, SortOrder=0)
panel_11 = Panel(number_12)
cluster_3 = Cluster_5(number=number_12)  # -> flatten(values_a)
panel_12 = Panel(cluster_3)

# ----
# red (small)
# blue (big)
number_slider_2 = Slider(0, range=0..400)
draw_ordered_element_gradient = BooleanToggle(True)
draw_printed_elements = BooleanToggle(True)
show_removed_elements = BooleanToggle(True)
compute_analysis = BooleanToggle(True)

construct_path = ConstructPath(Indices=number_slider_2)
tree_branch = TreeBranch(Tree=integer_7, Path=construct_path, MaintainPaths=True)
stream_filter = StreamFilter(Gate=compute_analysis, Stream1=curve_3)
integer_10 = Integer(tree_branch)
end_points = EndPoints(Curve=stream_filter)  # -> Start, End
point_6 = Point([end_points.Start, end_points.End])

# ---- group: highlight removed elements
list_item_4 = ListItem(List=curve_4, Index=integer_10, Wrap=True)
colour_cmyk = ColourCMYK(Cyan=Slider(1, range=0..1), Magenta=0, Yellow=0, Key=0)
pipe = Pipe(Curve=list_item_4, Radius=Slider(0.002, range=0..0.005), Caps=0)
stream_filter_2 = StreamFilter(Gate=show_removed_elements, Stream1=pipe)
custom_preview = CustomPreview(Geometry=stream_filter_2, Material=colour_cmyk)

# ----
remove_duplicate_points_karamba3d = RemoveDuplicatePointsKaramba3D(Point=point_6, LimitDistance=0.005)  # -> OutPoint, Info, Indexes

# ---- group: highlight printed elements
tree_branch_2 = TreeBranch(Tree=curve_3, Path=construct_path, MaintainPaths=True)
stream_filter_3 = StreamFilter(Gate=draw_printed_elements, Stream1=tree_branch_2)

# ----
point_7 = Point(remove_duplicate_points_karamba3d.OutPoint)

# ----
# existing nodes
point_8 = Point(simplify(point_7))

# ----
# existing elements
curve_6 = Curve(stream_filter)

point_9 = Point(point_8)
list_item_5 = ListItem(List=point_5, Index=integer_9, Wrap=True)
curve_7 = Curve(curve_6)

# ---- group: radius
number_14 = Number(cluster.radius)

# ----
curve_8 = Curve(curve_5)

# ----
# full structure analysis
cluster_4 = Cluster_2(number=number_slider, point=list_item_5, point_2=point_5, line=curve_8, material=cluster.material, thickness=number_14)  # -> result, data, result_2, result_3, simplify(number_5), calculated_model

number_15 = Number(cluster_4.number_5)
multiplication_3 = Multiplication(A=number_3, B=number_15)
number_16 = Number(multiplication_3)
quick_graph_2 = QuickGraph(number_16, SortOrder=0)
panel_13 = Panel(number_16)
subtraction = Subtraction(A=number_16, B=number_12)
cluster_5 = Cluster_5(number=number_16)  # -> flatten(values_a)
division = Division(A=subtraction, B=number_16)
bar_graph = BarGraph(division, BarColor=RGB(255, 0, 90))
panel_14 = Panel(cluster_5)
ghpython_script_3 = GhPythonScript(std_list=cluster_5, shuffled=cluster_3)  # -> out, a; inputs std_list: list of Int32, shuffled: list of Int32
# ---------- ghpython_script_3: Python ----------
a = [std_list.index(var) for var in shuffled]
# ---------- end ghpython_script_3 ----------
cluster_6 = Cluster_6(list=ghpython_script_3.a)
integer_11 = Integer(cluster_6)
panel_15 = Panel(integer_11)
panel_16 = Panel(ghpython_script_3.a)
subtraction_2 = Subtraction(A=ghpython_script_3.a, B=integer_11)
absolute = Absolute(Value=subtraction_2)
panel_17 = Panel(absolute)
bar_graph_2 = BarGraph(absolute, BarColor=RGB(255, 0, 90))
quick_graph_3 = QuickGraph(absolute, SortOrder=0)

# ---- group: full compliance
number_17 = Number(flatten(cluster_4.number_5))

# ----
# partial structure analysis
cluster_7 = Cluster_2(number=number_slider, point=point_4, point_2=point_9, line=curve_7, material=cluster.material, thickness=number_14)  # -> simplify(result), simplify(data), simplify(result_2), result_3, simplify(number_5), simplify(calculated_model)

number_18 = Number(cluster_7.number_5)

# ---- group: partial compliance
number_19 = Number(number_18)

# ----
partial_structure_compliance = Panel(number_19)
full_structure_compliance = Panel(number_17)

number_20 = Number(cluster_7.result_3)
division_2 = Division(A=partial_structure_compliance, B=number_17)
shift_paths = ShiftPaths(Data=number_20, Offset=-1)
sort_list = SortList(Keys=flatten(cluster_4.result_3))  # -> reverse(Keys), ValuesValuesA
sort_list_2 = SortList(Keys=shift_paths)  # -> reverse(Keys), ValuesValuesA
number_21 = Number(flatten(division_2))
list_item_6 = ListItem(List=sort_list.Keys, Index=0, Wrap=True)

# ---- group: full max nodal translation
number_22 = Number(flatten(list_item_6))

# ----
list_item_7 = ListItem(List=sort_list_2.Keys, Index=0, Wrap=True)

# ---- group: partial max nodal translation
number_23 = Number(list_item_7)

# ----
partial_max_nodal_trans = Panel(number_23)
full_max_nodal_trans = Panel(number_22)

division_3 = Division(A=number_23, B=number_22)
number_24 = Number(flatten(division_3))
construct_path_2 = ConstructPath(Indices=number_slider_2)
panel_18 = Panel(list_item_6)
tree_branch_3 = TreeBranch(Tree=cluster_7.calculated_model, Path=construct_path_2, MaintainPaths=True)
model_view_karamba3d = ModelViewKaramba3D(Model=tree_branch_3, LoadCaseFactorsForLinearSuperposition=1, IndexOfVisibleLoadcase=-1)  # -> Model, DeformedMesh, DeformedAxes, DeformedModel
beam_view_karamba3d = BeamViewKaramba3D(Model=model_view_karamba3d.Model)  # -> Model, MeshesOfRenderedBeams, DeformedBeamAxes, LegendColors, LegendTags
legend = Legend(Colour=beam_view_karamba3d.LegendColors, Tags=beam_view_karamba3d.LegendTags, LegendType=1)

# ----
# small compliance (red) means removing it has
# little impact on the structure
# 
# large compliance (blue) means removing it has
# a large impact on the structure
number_25 = Number(number_8)
sort_list_3 = SortList(Keys=number_25)  # -> Keys, ValuesValuesA
integer_12 = Integer(flatten(integer_3))
list_item_8 = ListItem(List=sort_list_3.Keys, Index=0, Wrap=True)  # -> Item1, Item
number_slider_3 = Slider(255, range=0..255)
list_item_9 = ListItem(List=curve, Index=integer_12, Wrap=False)
pipe_2 = Pipe(Curve=list_item_9, Radius=Slider(0.002, range=0..0.005), Caps=0)  # -> flatten(Pipe)
stream_filter_4 = StreamFilter(Gate=draw_ordered_element_gradient, Stream1=pipe_2)

subtraction_3 = Subtraction(A=number_25, B=list_item_8.Item)
absolute_2 = Absolute(Value=subtraction_3)
subtraction_4 = Subtraction(A=list_item_8.Item1, B=list_item_8.Item)
list_item_10 = ListItem(List=integer_12, Index=Slider(130, range=0..305), Wrap=True)
list_item_11 = ListItem(List=stream_filter_4, Index=list_item_10, Wrap=True)

division_4 = Division(A=absolute_2, B=subtraction_4)  # -> flatten(Result)
number_26 = Number(division_4)
subtraction_5 = Subtraction(A="1", B=division_4)
multiplication_4 = Multiplication(A=number_26, B=number_slider_3)
multiplication_5 = Multiplication(A=subtraction_5, B=number_slider_3)
colour_hsv = ColourHSV(Alpha=1, Hue=number_26, Saturation=1, Value=1)

panel_19 = Panel(division_4)

# ---- group: small -> big : red -> blue
colour_rgb = ColourRGB(Alpha=255, Red=multiplication_5, Green=0, Blue=multiplication_4)

# ----
custom_preview_2 = CustomPreview(Geometry=stream_filter_4, Material=colour_rgb)

# ==== cluster Cluster_2
number = ClusterInput()
point = ClusterInput()
material = ClusterInput()
thickness = ClusterInput()
line = ClusterInput()
point_2 = ClusterInput()
number_2 = Number(number)
point_3 = Point(point)
# Gravity load
unit_z = UnitZ(Factor=number_2)
# Supports
support_karamba3d = SupportKaramba3D(PosInd=point_3, menu=[buttons(on, on, on, on, on, on)])
negative = Negative(Value=unit_z)
multiplication = Multiplication(A=thickness, B="2")
support_karamba3d_2 = SupportKaramba3D(support_karamba3d)
loads_karamba3d = LoadsKaramba3D(Vector=negative, LCase=0, mode="Gravity")
cross_section_karamba3d = CrossSectionKaramba3D(
    FamilyNameOfCrossSection="DefaultCroSec",
    Material=material,
    Diameter_cm=multiplication,
    WallThickness_cm=thickness,
    mode="Circular Hollow")
point_4 = Point(point_2)
line_to_beam_karamba3d = LineToBeamKaramba3D(Line=line, CrossSection=cross_section_karamba3d, Points=point_4, New=True, Remove=True, LimitDistance_m=0.005)  # -> Element, Points, Info
load_karamba3d = LoadKaramba3D(loads_karamba3d)
assemble_model_karamba3d = AssembleModelKaramba3D(
    Point=point_4,
    Elem=line_to_beam_karamba3d.Element,
    Support=support_karamba3d_2,
    Load=load_karamba3d,
    LimitDistance_m=0.005)  # -> simplify(Model), simplify(Info), Mass_kg, CenterOfGravity
analyze_karamba3d = AnalyzeKaramba3D(Model=assemble_model_karamba3d.Model)  # -> CalculatedModel, MaximumDisplacement_cm, ResultingForceOfGravity_kN, ElasticEnergy_kNm
panel = Panel(assemble_model_karamba3d.Info)
reaction_forces_karamba3d = ReactionForcesKaramba3D(AnalyzedModel=analyze_karamba3d.CalculatedModel, LoadCase=0)  # -> AnalyzedModel, ReactionForces_kN, ReactionMoments_kNm, SupportPosition, SumOfReactionForces_kN, SumOfReactionMoments_kNm
nodal_displacements_karamba3d = NodalDisplacementsKaramba3D(AnalyzedModel=analyze_karamba3d.CalculatedModel, LoadCase=0)  # -> AnalyzedModel, NodalTranslations_m, NodalRotations_rad
beam_forces_karamba3d = BeamForcesKaramba3D(
    AnalyzedModel=analyze_karamba3d.CalculatedModel,
    LCase=-1,
    MaximumDistanceBetweenResults_m=-1,
    NumberOfResultsPerBeamElement=2)  # -> AnalyzedModel, NormalForce_kN, ShearForceVz_kN, ShearForceVy_kN, BendingMomentMt_kNm, BendingMomentMy_kNm, BendingMomentMz_kNm
deconstruct = Deconstruct(Point=simplify(graft(reaction_forces_karamba3d.ReactionForces_kN)))  # -> XComponent, YComponent, ZComponent
deconstruct_2 = Deconstruct(Point=simplify(graft(reaction_forces_karamba3d.ReactionMoments_kNm)))  # -> XComponent, YComponent, ZComponent
merge = Merge(
    Data1=simplify(graft(nodal_displacements_karamba3d.NodalTranslations_m)),
    Data2=simplify(graft(nodal_displacements_karamba3d.NodalRotations_rad)))
evaluate = Evaluate(Expression="format(\"{0:E} {1:E} {2:E}\",x.x,x.y,x.z)", x=merge)
merge_2 = Merge(
    Data1=deconstruct.XComponent,
    Data2=deconstruct.YComponent,
    Data3=deconstruct.ZComponent,
    Data4=deconstruct_2.XComponent,
    Data5=deconstruct_2.YComponent,
    Data6=deconstruct_2.ZComponent)
merge_3 = Merge(
    Data1=graft(beam_forces_karamba3d.NormalForce_kN),
    Data2=graft(beam_forces_karamba3d.ShearForceVz_kN),
    Data3=graft(beam_forces_karamba3d.ShearForceVy_kN),
    Data4=graft(beam_forces_karamba3d.BendingMomentMt_kNm),
    Data5=graft(beam_forces_karamba3d.BendingMomentMy_kNm),
    Data6=graft(beam_forces_karamba3d.BendingMomentMz_kNm))  # -> simplify(Result)
evaluate_2 = Evaluate(Expression="format(\"{0:E}\",x)", x=merge_2)
cluster = Cluster(text=evaluate, separators=" ")
evaluate_3 = Evaluate(Expression="format(\"{0:E}\",x)", x=merge_3)
reaction_force_kn_reaction_moment_kn_m = Panel(merge_2)
shift_paths = ShiftPaths(Data=cluster, Offset=-1)
list_item = ListItem(List=shift_paths, Index=0, Wrap=True)  # -> Item, Item1, Item2
froce_kn_moment_kn_m = Panel(merge_3)
nodal_displacement_m_rad = Panel(shift_paths)
merge_4 = Merge(Data1=list_item.Item, Data2=list_item.Item1, Data3=list_item.Item2)
number_3 = Number(merge_4)
square = Square(Value=number_3)
mass_addition = MassAddition(Input=square)  # -> Result, PartialResults
square_root = SquareRoot(Value=mass_addition.Result)
number_4 = Number(analyze_karamba3d.ElasticEnergy_kNm)
calculated_model = ClusterOutput(analyze_karamba3d.CalculatedModel)
result = ClusterOutput(merge_3)
data = ClusterOutput(shift_paths)
number_5 = ClusterOutput(number_4)
result_2 = ClusterOutput(merge_2)
result_3 = ClusterOutput(square_root)

# ==== cluster Cluster_3
frame_json_file_path = ClusterInput()
scale = ClusterInput()
ghpython_script = GhPythonScript(frame_json_file_path=frame_json_file_path, scale=scale)  # -> out, all_nodes, all_elements, simplify(all_element_node_ids), all_fix_node_ids, material_name, E, E_unit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
# ---------- ghpython_script: Python ----------
import rhinoscriptsyntax as rs
import Rhino.Geometry as rg
from Grasshopper import DataTree as datatree
from Grasshopper.Kernel.Data import GH_Path as ghpath
import System
import math

from ghpythonlib.treehelpers import list_to_tree, tree_to_list

import scriptcontext as sc
pyconmech = sc.sticky['pyconmech']
np = sc.sticky['numpy']

def rvector2list(rv):
    return [rv.X, rv.Y, rv.Z]

frame_info = pyconmech.frame_analysis.frame_file_io.read_frame_json(frame_json_file_path, verbose=True)

node_points, element_vids, fix_node_ids, fix_specs, model_type, material_dicts, model_name = frame_info

all_nodes = [rs.CreatePoint(scale*pt[0], scale*pt[1], scale*pt[2]) for pt in node_points]
all_elements = [rg.Line(all_nodes[n1], all_nodes[n2]) for n1, n2 in element_vids]

all_element_node_ids = list_to_tree(element_vids)
all_fix_node_ids = [int(v) for v in fix_node_ids]

material_name = material_dicts[0]['material_name']
E = material_dicts[0]['youngs_modulus']
E_unit = material_dicts[0]['youngs_modulus_unit']

G = material_dicts[0]['shear_modulus']
G_unit = material_dicts[0]['shear_modulus_unit']

if 'tensile_yeild_stress' in material_dicts[0]:
    sigma = material_dicts[0]['tensile_yeild_stress']
    sigma_unit = material_dicts[0]['tensile_yeild_stress_unit']

rho = material_dicts[0]['density']
rho_unit = material_dicts[0]['density_unit']

r = math.sqrt(material_dicts[0]['cross_sec_area'] / math.pi)
r_unit = 'centimeter'
# ---------- end ghpython_script ----------
data = Data(ghpython_script.G_unit)
data_2 = Data(ghpython_script.material_name)
data_3 = Data(ghpython_script.E)
data_4 = Data(ghpython_script.E_unit)
data_5 = Data(ghpython_script.G)
data_6 = Data(ghpython_script.r)
data_7 = Data(ghpython_script.sigma)
data_8 = Data(ghpython_script.rho)
data_9 = Data(ghpython_script.sigma_unit)
data_10 = Data(ghpython_script.rho_unit)
data_11 = Data(ghpython_script.r_unit)
panel = Panel(data_3)
panel_2 = Panel(data_5)
panel_3 = Panel(data_4)
panel_4 = Panel(data_11)
panel_5 = Panel(data_10)
panel_6 = Panel(data_2)
panel_7 = Panel(data)
panel_8 = Panel(data_7)
panel_9 = Panel(data_8)
panel_10 = Panel(data_9)
panel_11 = Panel(data_6)
material_properties_karamba3d = MaterialPropertiesKaramba3D(
    FamilyOfMaterial=panel_6,
    Name="0",
    YoungsModulus_kN_cm2=panel,
    InPlaneShearModulus_kN_cm2=panel_2,
    TransverseShearModulus_kN_cm2=panel_2,
    SpecificWeight_kN_m3=panel_9,
    CoefficientOfThermalExpansion_1_C=1e-05,
    YieldStrength_kN_cm2=Slider(23.5, range=0..100),
    mode="Isotrop")
all_nodes = ClusterOutput(ghpython_script.all_nodes)
all_element_node_ids = ClusterOutput(ghpython_script.all_element_node_ids)
all_elements = ClusterOutput(ghpython_script.all_elements)
all_fix_node_ids = ClusterOutput(ghpython_script.all_fix_node_ids)
radius = ClusterOutput(panel_11)  # radius
material = ClusterOutput(material_properties_karamba3d)

# ==== cluster Cluster_4
keys = ClusterInput()
integer = ClusterInput()
integer_2 = Integer(integer)
sort_list = SortList(Keys=keys, ValuesValuesA=integer_2)  # -> Keys, ValuesValuesA
integer_3 = Integer(sort_list.ValuesValuesA)
integer_4 = Integer(integer_2)
replace_items = ReplaceItems(List=integer_4, Item=integer_4, Indices=integer_3, Wrap=False)
list = ClusterOutput(replace_items)

# ==== cluster Cluster_5
number = ClusterInput()
number_2 = Number(number)
list_length = ListLength(List=number_2)
series = Series(Start=0, Step=1, Count=list_length)
sort_list = SortList(Keys=number_2, ValuesValuesA=series)  # -> Keys, ValuesValuesA
values_a = ClusterOutput(sort_list.ValuesValuesA)

# ==== cluster Cluster_6
list = ClusterInput()
list_length = ListLength(List=list)
series = Series(Start=0, Step=1, Count=list_length)
series_2 = ClusterOutput(series)

# ==== cluster Cluster
text = ClusterInput()
separators = ClusterInput()
text_split = TextSplit(Text=text, Separators=separators)
number = Number(text_split)
clean_tree = CleanTree(RemoveNulls=True, RemoveInvalid=True, RemoveEmpty=False, Tree=number)
tree = ClusterOutput(clean_tree)
