# Grasshopper definition viz_stiffness_checker_search_history.ghx (Grasshopper 1.0.7)
# plug-ins: karambaGH

panel = Panel("voronoi_S1_03-14-2019_w_layer.json")
python = PythonScript()  # -> rhino_doc_dir, extrusion_instance_dir, extrusion_plan_dir, extrusion_log_dir
# ---------- python: Python ----------
import scriptcontext as sc
from os import path

rhino_doc_dir = path.abspath(path.dirname(sc.doc.Path))
extrusion_instance_dir = path.join(rhino_doc_dir, '..', '..', \
    'assembly_instances', 'extrusion')
extrusion_plan_dir = path.join(rhino_doc_dir, '..', 'extrusion_results')
extrusion_log_dir = path.join(rhino_doc_dir, '..', 'extrusion_log')
# ---------- end python ----------

# ---- group: Import remote python modules
panel_2 = Panel("C:\Users\yijiangh\Software\Miniconda\envs\rhinoremote\python.exe")
python_2 = PythonScript()  # -> rhino_doc_dir
# ---------- python_2: Python ----------
import scriptcontext as sc
from os import path

rhino_doc_dir = path.abspath(path.dirname(sc.doc.Path))
# ---------- end python_2 ----------
panel_3 = Panel(python_2)
panel_4 = Panel("""numpy
numpy.linalg
pyconmech""")
list = ValueList({"CRITICAL", "ERROR", "WARNING", "INFO", "DEBUG", "NOTSET"}, selected="DEBUG")
ghpythonremote = GHPythonRemote(location=panel_2, run=Toggle(True), modules=panel_4, log_level=list, working_dir=panel_3)  # -> out, linked_modules, rpy; inputs run: Boolean, modules: list
# ---------- ghpythonremote: Python ----------
import sys
import scriptcontext
import logging
import inspect
import ghpythonremote
from ghpythonremote.connectors import GrasshopperToPythonRemote
from os import path
from time import sleep

local_log_level = getattr(logging, log_level, logging.WARNING)
logger = logging.getLogger('ghpythonremote')
logger.setLevel(local_log_level)
ch = logging.StreamHandler()
ch.setLevel(local_log_level)
formatter = logging.Formatter('%(levelname)s: %(name)s:\n%(message)s')
ch.setFormatter(formatter)
logger.handlers = []
logger.addHandler(ch)
logger = logging.getLogger('ghpythonremote.GH_to_python')

ROOT = path.abspath(path.dirname(inspect.getfile(ghpythonremote)))
rpyc_server_py = path.join(ROOT, 'pythonservice.py')

# Set connection to CLOSED if this is the first run
# and initialize set of linked modules
try:
    remote_python_status
except NameError:
    remote_python_status = 'CLOSED'
    lkd_modules = set()

# Wait for connection to connect or terminate
timer = 0
while remote_python_status == 'CONNECTING' or remote_python_status == 'CLOSING':
    sleep(1)
    timer += 1
    if timer == 10:
        try:
            gh2py_manager.__exit__(*sys.exc_info())
        except Exception:
            pass
        remote_python_status = 'CLOSED'
        lkd_modules = set()
        raise RuntimeError("Connection left in an inconsistent state and not returning. Reset everything.")

if run:
    if not remote_python_status == 'OPEN':
        remote_python_status = 'CONNECTING'
        gh2py_manager = GrasshopperToPythonRemote(rpyc_server_py, location=location, timeout=10,
                                                  port=None, log_level=log_level, working_dir=working_dir)
        gh2py = gh2py_manager.__enter__()
        remote_python_status = 'OPEN'

    # Stuff that we can reach
    rpymod = gh2py.py_remote_modules  # A getter function for a named python module
    rpy = gh2py.connection  # Represents the remote instance root object
    scriptcontext.sticky['rpy'] = rpy
    # Add modules
    for mod in modules:
        try:
            scriptcontext.sticky[mod] = rpymod(mod)
            lkd_modules.add(mod)
        except ImportError:
            gh2py_manager.__exit__(*sys.exc_info())
            raise

elif not remote_python_status == 'CLOSED':
    remote_python_status = 'CLOSING'
    # Remove linked modules
    for mod in lkd_modules:
        del scriptcontext.sticky[mod]
    del scriptcontext.sticky['rpy']
    gh2py_manager.__exit__(*sys.exc_info())
    lkd_modules = set()
    remote_python_status = 'CLOSED'

# Change variable name because ghpython resets outputs to None before each run
linked_modules = lkd_modules

logger.info('GH to python connection is {}'.format(remote_python_status))
# ---------- end ghpythonremote ----------
python_3 = PythonScript(module_names=ghpythonremote.linked_modules)  # -> import_statements; inputs module_names: list
# ---------- python_3: Python ----------
import_statements = ["import scriptcontext as sc"]
for module_name in module_names:
    import_statements.append("{0} = sc.sticky['{0}']".format(module_name))

if len(module_names) == 0:
    import_statements = []
# ---------- end python_3 ----------
panel_5 = Panel(python_3)

# ----
panel_6 = Panel(python.extrusion_instance_dir)
concatenate = Concatenate(Fragment_A=python.extrusion_instance_dir, A="\", Fragment_B="topopt-100_S1_03-14-2019_w_layer.json")
number = Number(Slider(1, range=0..1))
text = Text(concatenate)
ghpython_script = GhPythonScript(extrusion_path=text, gravity_scale=number)  # -> out, partial_compliance
# ---------- ghpython_script: Python ----------
import os
import scriptcontext as sc
pyconmech = sc.sticky['pyconmech']
np = sc.sticky['numpy']

abs_path = os.path.abspath(extrusion_path)
checker = pyconmech.frame_analysis.stiffness_checker.StiffnessChecker(json_file_path=extrusion_path)

checker.set_loads(include_self_weight=True, gravity_direction=[0, 0, gravity_scale])

TRANS_TOL = 0.005
ROT_TOL = 10 * np.pi / 180
checker.set_nodal_displacement_tol(trans_tol=TRANS_TOL, rot_tol=ROT_TOL)

elements = checker.elements
element_ids = set(range(len(elements)))

partial_compliance = []
for i in list(element_ids):
    extruded_ids = list(element_ids - {i})
    checker.solve(exist_element_ids=extruded_ids)
    partial_compliance.append(checker.get_compliance())
# ---------- end ghpython_script ----------
# variation of time history of scores
panel_7 = Panel("topopt-100_S1_03-14-2019_w_layer_log_regression-stiffness-compliance.json")
panel_8 = Panel("voronoi_S1_03-14-2019_w_layer_log_regression-stiffness-compliance.json")
panel_9 = Panel("voronoi_S1_03-14-2019_w_layer_log_regression-stiffness-nodal_translation.json")

show_removed_elements = BooleanToggle(True)
show_printed_elements = BooleanToggle(True)
draw_candidate_gradient = BooleanToggle(True)

number_2 = Number(simplify(graft(ghpython_script.partial_compliance)))
number_slider = Slider(30, range=0..131)
python_4 = PythonScript()  # -> rhino_doc_dir, extrusion_instance_dir, extrusion_plan_dir, extrusion_log_dir; same code as python

# ---- group: load log json
panel_10 = Panel("voronoi_S1_03-14-2019_w_layer_log_regression-z.json")
concatenate_2 = Concatenate(Fragment_A=python_4.extrusion_log_dir, A="\", Fragment_B=panel_7)
ghpython_script_2 = GhPythonScript(seq_result_file_path=concatenate_2)  # -> out, total_queue_len, removed_elements_tree, queue_ids_tree, queue_scores_tree, backtracks, total_e_num
# ---------- ghpython_script_2: Python ----------
import rhinoscriptsyntax as rs
import Grasshopper.DataTree as datatree
import Grasshopper.Kernel.Data.GH_Path as ghpath
import System

import json

with open(seq_result_file_path, 'r') as f:
    json_data = json.loads(f.read())

search_log_data = json_data['search_log']

def priority_composite(p):
    return 100 * p[0] + 100 * abs(p[1]) + p[0]

# each data tree branch represents a search iteration
# - element ids on the queue in ascending order
# - score
queue_ids_tree = datatree[System.Object]()
queue_scores_tree = datatree[System.Object]()
removed_elements_tree = datatree[System.Object]()
total_queue_len = []
removed_elements = []
backtracks = []
total_e_num = json_data['total_e_num']

for iter_data in search_log_data:
    iter = iter_data['iter']
    removed_elements.append(iter_data['chosen_id'])
    removed_elements_tree.AddRange(removed_elements, ghpath(iter))
    total_queue_len.append(iter_data['total_q_len'])
    backtracks.append(iter_data['backtrack'])
    
    queue_ids = [cand[0] for cand in iter_data['queue']]
    
#    queue_scores = [priority_composite(cand[1]) for cand in iter_data['queue']]
#    # normalization
#    max_s = max(queue_scores)
#    min_s = min(queue_scores)
#    queue_scores = [(s - min_s) / (max_s - min_s) for s in queue_scores]
    
    queue_ids_tree.AddRange(queue_ids, ghpath(iter))
    for i, cand in enumerate(iter_data['queue']):
        queue_scores_tree.AddRange(cand[1], ghpath(iter, i))
    
    
print('computed time: {}'.format(json_data['write_time']))
print('search method: {}'.format(json_data['search_method']))
print('heuristic: {}'.format(json_data['heuristic']))
print('stiffness criteria: {}'.format(json_data['stiffness_criteria']))
print('allowed max_time: {}'.format(json_data['max_time']))
print('allowed max_backtrack: {}'.format(json_data['max_backtrack']))
print('total_e_num in the model: {}'.format(total_e_num))
print('maximal backtrack in search: {}'.format(max(backtracks)))
# ---------- end ghpython_script_2 ----------

# ---- group: load plan json
concatenate_3 = Concatenate(Fragment_A=python_4.extrusion_plan_dir, A="\", Fragment_B="voronoi_solution_regression-z.json")
ghpython_script_3 = GhPythonScript(seq_result_file_path=concatenate_3)  # -> out, seq_e_ids
# ---------- ghpython_script_3: Python ----------
__author__ = "harry"
__version__ = "2019.08.22"

import rhinoscriptsyntax as rs
import json

with open(seq_result_file_path, 'r') as f:
    json_data = json.loads(f.read())

seq_e_ids = json_data['plan']
del json_data['plan']
print(json_data)
# ---------- end ghpython_script_3 ----------

# ----
ghpython_script_4 = GhPythonScript(
    queue_ids_tree=ghpython_script_2.queue_ids_tree,
    queue_score_tree=ghpython_script_2.queue_scores_tree,
    total_e_num=ghpython_script_2.total_e_num)  # -> out, pos_in_queue, score_dep_in_queue, score_stiffness_in_queue; inputs queue_ids_tree: tree of Int32, queue_score_tree: tree, total_e_num: Int32
# ---------- ghpython_script_4: Python ----------
import rhinoscriptsyntax as rs
import Grasshopper.DataTree as datatree
import Grasshopper.Kernel.Data.GH_Path as ghpath
import System

from ghpythonlib.treehelpers import list_to_tree, tree_to_list

queue_ids = tree_to_list(queue_ids_tree, lambda x : x)
queue_scores = tree_to_list(queue_score_tree, lambda x : x)

pos_in_queue = datatree[System.Double]()
score_dep_in_queue = datatree[System.Double]()
score_stiffness_in_queue = datatree[System.Double]()

for i, (e_ids, scores) in enumerate(zip(queue_ids, queue_scores)):
    if not e_ids:
        break
    for orig_id in range(total_e_num):
        if orig_id in e_ids:
            index = e_ids.index(orig_id)
            pos_in_queue.Add(index, ghpath(orig_id))
            
            score = scores[index]
            score_dep_in_queue.Add(score[0], ghpath(orig_id))
            score_stiffness_in_queue.Add(score[1], ghpath(orig_id))
        else:
            pos_in_queue.Add(-1, ghpath(orig_id))
            score_dep_in_queue.Add(-1, ghpath(orig_id))
            score_stiffness_in_queue.Add(0, ghpath(orig_id))
# ---------- end ghpython_script_4 ----------
construct_path = ConstructPath(Indices=number_slider)
integer = Integer(number_slider)
construct_path_2 = ConstructPath(Indices=Slider(2, range=1..400))
tree_branch = TreeBranch(Tree=number_2, Path=construct_path, MaintainPaths=True)
concatenate_4 = Concatenate(Fragment_A=python_4.extrusion_instance_dir, A="\", Fragment_B="voronoi_S1_03-14-2019_w_layer.json")
tree_branch_2 = TreeBranch(Tree=ghpython_script_4.score_stiffness_in_queue, Path=construct_path, MaintainPaths=True)
sort_list = SortList(Keys=tree_branch_2)  # -> Keys, ValuesA
list_item = ListItem(List=sort_list.Keys, Index=0, Wrap=True)  # -> Item1, Item
tree_branch_3 = TreeBranch(Tree=ghpython_script_4.score_dep_in_queue, Path=construct_path, MaintainPaths=True)
tree_branch_4 = TreeBranch(Tree=ghpython_script_4.pos_in_queue, Path=construct_path, MaintainPaths=True)

# ---- group: queue e_ids
tree_branch_5 = TreeBranch(Tree=ghpython_script_2.queue_ids_tree, Path=construct_path_2, MaintainPaths=True)  # disabled

# ---- group: queue score
tree_branch_6 = TreeBranch(Tree=ghpython_script_2.queue_scores_tree, Path=construct_path_2, MaintainPaths=True)  # disabled

# ----
panel_11 = Panel(tree_branch_6)
division = Division(A=tree_branch_2, B=tree_branch)
quick_graph = QuickGraph(tree_branch_3, SortOrder=0)
quick_graph_2 = QuickGraph(tree_branch_4, SortOrder=0)
quick_graph_3 = QuickGraph(division, SortOrder=0)
integer_2 = Integer(ghpython_script_2.backtracks)
panel_12 = Panel(ghpython_script_2.out)
number_slider_2 = Slider(255, range=0..255)
panel_13 = Panel(ghpython_script_2.queue_scores_tree)
bar_graph = BarGraph(tree_branch_3, BarColor=RGB(255, 0, 90))
bar_graph_2 = BarGraph(tree_branch_4, BarColor=RGB(255, 0, 90))
bar_graph_3 = BarGraph(division, BarColor=RGB(255, 0, 90))
subtraction = Subtraction(A="1", B=tree_branch_6)
multiplication = Multiplication(A=tree_branch_6, B=number_slider_2)
multiplication_2 = Multiplication(A=subtraction, B=number_slider_2)

# ---- group: small -> big : red -> blue
# small compliance (red) means removing it has
# little impact on the structure
# 
# large compliance (blue) means removing it has
# a large impact on the structure
colour_rgb = ColourRGB(Alpha=255, Red=multiplication_2, Green=0, Blue=multiplication)

# ---- group: plan sequence e_ids
integer_3 = Integer(reverse(ghpython_script_3.seq_e_ids))

# ---- group: removed element ids
integer_4 = Integer(ghpython_script_2.removed_elements_tree)
tree_branch_7 = TreeBranch(Tree=integer_4, Path=construct_path_2, MaintainPaths=True)

# ----
integer_5 = Integer(tree_branch_7)
set_difference = SetDifference(SetA=tree_branch_5, SetB=integer_5)

# ----
# existing element ids
integer_6 = Integer()

material_properties_karamba3d = MaterialPropertiesKaramba3D(
    FamilyOfMaterial="Steel",
    Name="S235",
    YoungsModulus_kN_cm2=21000,
    InPlaneShearModulus_kN_cm2=8076,
    TransverseShearModulus_kN_cm2=8076,
    SpecificWeight_kN_m3=78.5,
    CoefficientOfThermalExpansion_1_C=1e-05,
    YieldStrength_kN_cm2=23.5,
    mode="Isotrop")
cluster = Cluster_5(frame_json_file_path=concatenate_4, scale=Slider(1, range=0..1000))  # -> all_nodes, all_elements, all_element_node_ids, all_fix_node_ids, material, radius
panel_14 = Panel(cluster.material)
panel_15 = Panel(material_properties_karamba3d)
ghpython_script_5 = GhPythonScript(existing_e_ids=integer_6, all_element_node_ids=cluster.all_element_node_ids, all_fix_node_ids=cluster.all_fix_node_ids)  # -> out, exist_fix_node_ids; inputs existing_e_ids: list of Int32, all_element_node_ids: tree of Int32, all_fix_node_ids: list of Int32
# ---------- ghpython_script_5: Python ----------
from ghpythonlib.treehelpers import list_to_tree, tree_to_list

element_vids = tree_to_list(all_element_node_ids, lambda x : x)
existing_e_ids = existing_e_ids or list(range(len(element_vids)))

existing_node_ids = set()
for e_id, e_tuple in enumerate(element_vids):
    if e_id in existing_e_ids:
        existing_node_ids.update(e_tuple)

print(all_fix_node_ids)

exist_fix_node_ids = [int(v) for v in all_fix_node_ids if v in existing_node_ids]

#existing_elements = datatree[System.Object]()
#for e_id in existing_ids:
#    existing_elements.Add(rg.Line(all_nodes[element_vids[e_id][0]], all_nodes[element_vids[e_id][1]]), ghpath(e_id))
#
#existing_nodes = datatree[System.Object]()
#for n_id in existing_node_ids:
#    existing_nodes.Add(all_nodes[n_id], ghpath(n_id))
# ---------- end ghpython_script_5 ----------

# ---- group: all nodes & elements
curve = Curve(cluster.all_elements)
point = Point(cluster.all_nodes)

# ----
list_item_2 = ListItem(List=curve, Index=integer_6, Wrap=True)
integer_7 = Integer(integer)
curve_2 = Curve(curve)
curve_3 = Curve(list_item_2)
end_points = EndPoints(Curve=curve_3)  # -> Start, End
point_2 = Point([end_points.Start, end_points.End])

# ---- group: highlight removed elements
list_item_3 = ListItem(List=curve_2, Index=integer_7, Wrap=True)
colour_cmyk = ColourCMYK(Cyan=Slider(1, range=0..1), Magenta=0, Yellow=0, Key=0)
pipe = Pipe(Curve=list_item_3, Radius=Slider(0.002, range=0..0.005), Caps=0)
stream_filter = StreamFilter(Gate=show_removed_elements, Stream1=pipe)
custom_preview = CustomPreview(Geometry=stream_filter, Material=colour_cmyk)

# ---- group: highlight printed elements
list_length = ListLength(List=curve_2)
ghpython_script_6 = GhPythonScript(x=list_length)  # -> out, a; inputs x: Int32
# ---------- ghpython_script_6: Python ----------
a = list(range(x))
# ---------- end ghpython_script_6 ----------
set_difference_2 = SetDifference(SetA=ghpython_script_6.a, SetB=integer_7)
list_item_4 = ListItem(List=curve_2, Index=set_difference_2, Wrap=True)
stream_filter_2 = StreamFilter(Gate=show_printed_elements, Stream1=list_item_4)

# ----
remove_duplicate_points_karamba3d = RemoveDuplicatePointsKaramba3D(Point=point_2, LimitDistance=0.005)  # -> OutPoint, Info, Indexes
point_3 = Point(remove_duplicate_points_karamba3d.OutPoint)
integer_8 = Integer(ghpython_script_5.exist_fix_node_ids)

# ----
# all nodes
point_4 = Point(point)

list_item_5 = ListItem(List=point_4, Index=integer_8, Wrap=True)

# ----
# existing nodes
point_5 = Point(flatten(point_3))

# ----
# existing elements
curve_4 = Curve(flatten(curve_3))

# ----
# grounded nodes
point_6 = Point(list_item_5)

cluster_2 = Cluster_3(model=curve_4)
point_7 = Point(point_5)
cluster_3 = Cluster_4(pts=point_7, target_pts=point_6, list=point_7)
curve_5 = Curve(curve)
point_8 = Point(point)
integer_9 = Integer(cluster.all_fix_node_ids)
list_item_6 = ListItem(List=point_8, Index=integer_9, Wrap=True)
curve_6 = Curve(curve_4)
number_3 = Number(cluster.radius)
curve_7 = Curve(curve_5)
number_4 = Number(cluster.radius)
cluster_4 = Cluster_2(point=list_item_6, point_2=point_8, line=curve_7, material=cluster.material, thickness=number_3)  # -> result, data, result_2, keys, elastic_energy_knm, calculated_model; disabled
cluster_5 = Cluster_2(point=point_6, point_2=point_7, line=curve_6, material=cluster.material, thickness=number_3)  # -> result, data, result_2, keys, elastic_energy_knm, calculated_model; disabled

partial_structure_compliance = Panel(cluster_5.elastic_energy_knm)
full_structure_compliance = Panel(cluster_4.elastic_energy_knm)
max_deformation_l2_on_trans = Panel(cluster_5.keys)

internal_froce_kn_moment_kn_m = Panel(cluster_5.result)
reaction_force_kn_reaction_moment_kn_m = Panel(cluster_5.result_2)
nodal_displacement_m_rad = Panel(cluster_5.data)

model_view_karamba3d = ModelViewKaramba3D(Model=cluster_5.calculated_model, LoadCaseFactorsForLinearSuperposition=1, IndexOfVisibleLoadcase=-1)  # -> Model, DeformedMesh, DeformedAxes, DeformedModel
beam_view_karamba3d = BeamViewKaramba3D(Model=model_view_karamba3d.Model)  # -> Model, MeshesOfRenderedBeams, DeformedBeamAxes, LegendColors, LegendTags
legend = Legend(Colour=beam_view_karamba3d.LegendColors, Tags=beam_view_karamba3d.LegendTags, LegendType=1)

# ---- group: highlight queue candidate elements
integer_10 = Integer(set_difference)
list_item_7 = ListItem(List=curve, Index=integer_10, Wrap=False)
pipe_2 = Pipe(Curve=list_item_7, Radius=Slider(0.002, range=0..0.005), Caps=0)  # -> flatten(Pipe)

# ----
stream_filter_3 = StreamFilter(Gate=draw_candidate_gradient, Stream1=pipe_2)

# ---- group: highlight queue candidate elements (continued)
custom_preview_2 = CustomPreview(Geometry=stream_filter_3, Material=colour_rgb)

# ==== cluster Cluster_2
point = ClusterInput()
material = ClusterInput()
thickness = ClusterInput()
line = ClusterInput()
point_2 = ClusterInput()
point_3 = Point(point)
# Gravity load
unit_z = UnitZ(Factor=1)
# Supports
support_karamba3d = SupportKaramba3D(PosInd=point_3, menu=[buttons(on, on, on, on, on, on)])
negative = Negative(Value=unit_z)
multiplication = Multiplication(A=thickness, B="2")
loads_karamba3d = LoadsKaramba3D(Vector=negative, LCase=0, mode="Gravity")
support_karamba3d_2 = SupportKaramba3D(support_karamba3d)
cross_section_karamba3d = CrossSectionKaramba3D(
    FamilyNameOfCrossSection="DefaultCroSec",
    Material=material,
    Diameter_cm=multiplication,
    WallThickness_cm=thickness,
    mode="Circular Hollow")
point_4 = Point(point_2)
line_to_beam_karamba3d = LineToBeamKaramba3D(Line=line, CrossSection=cross_section_karamba3d, Points=point_4, New=True, Remove=True, LimitDistance_m=0.005)  # -> Element, Points, Info
load_karamba3d = LoadKaramba3D(loads_karamba3d)
assemble_model_karamba3d = AssembleModelKaramba3D(
    Point=point_4,
    Elem=line_to_beam_karamba3d.Element,
    Support=support_karamba3d_2,
    Load=load_karamba3d,
    LimitDistance_m=0.005)  # -> Model, Info, Mass_kg, CenterOfGravity
analyze_karamba3d = AnalyzeKaramba3D(Model=assemble_model_karamba3d.Model)  # -> CalculatedModel, MaximumDisplacement_cm, ResultingForceOfGravity_kN, ElasticEnergy_kNm
reaction_forces_karamba3d = ReactionForcesKaramba3D(AnalyzedModel=analyze_karamba3d.CalculatedModel, LoadCase=0)  # -> AnalyzedModel, ReactionForces_kN, ReactionMoments_kNm, SupportPosition, SumOfReactionForces_kN, SumOfReactionMoments_kNm
nodal_displacements_karamba3d = NodalDisplacementsKaramba3D(AnalyzedModel=analyze_karamba3d.CalculatedModel, LoadCase=0)  # -> AnalyzedModel, NodalTranslations_m, NodalRotations_rad
beam_forces_karamba3d = BeamForcesKaramba3D(
    AnalyzedModel=analyze_karamba3d.CalculatedModel,
    LCase=-1,
    MaximumDistanceBetweenResults_m=-1,
    NumberOfResultsPerBeamElement=2)  # -> AnalyzedModel, NormalForce_kN, ShearForceVz_kN, ShearForceVy_kN, BendingMomentMt_kNm, BendingMomentMy_kNm, BendingMomentMz_kNm
deconstruct = Deconstruct(Point=simplify(graft(reaction_forces_karamba3d.ReactionForces_kN)))  # -> XComponent, YComponent, ZComponent
deconstruct_2 = Deconstruct(Point=simplify(graft(reaction_forces_karamba3d.ReactionMoments_kNm)))  # -> XComponent, YComponent, ZComponent
merge = Merge(
    Data1=simplify(graft(nodal_displacements_karamba3d.NodalTranslations_m)),
    Data2=simplify(graft(nodal_displacements_karamba3d.NodalRotations_rad)))
evaluate = Evaluate(Expression="format(\"{0:E} {1:E} {2:E}\",x.x,x.y,x.z)", x=merge)
merge_2 = Merge(
    Data1=deconstruct.XComponent,
    Data2=deconstruct.YComponent,
    Data3=deconstruct.ZComponent,
    Data4=deconstruct_2.XComponent,
    Data5=deconstruct_2.YComponent,
    Data6=deconstruct_2.ZComponent)
merge_3 = Merge(
    Data1=graft(beam_forces_karamba3d.NormalForce_kN),
    Data2=graft(beam_forces_karamba3d.ShearForceVz_kN),
    Data3=graft(beam_forces_karamba3d.ShearForceVy_kN),
    Data4=graft(beam_forces_karamba3d.BendingMomentMt_kNm),
    Data5=graft(beam_forces_karamba3d.BendingMomentMy_kNm),
    Data6=graft(beam_forces_karamba3d.BendingMomentMz_kNm))  # -> simplify(Result)
evaluate_2 = Evaluate(Expression="format(\"{0:E}\",x)", x=merge_2)
cluster = Cluster(text=evaluate, separators=" ")
evaluate_3 = Evaluate(Expression="format(\"{0:E}\",x)", x=merge_3)
reaction_force_kn_reaction_moment_kn_m = Panel(merge_2)
shift_paths = ShiftPaths(Data=cluster, Offset=-1)
list_item = ListItem(List=shift_paths, Index=0, Wrap=True)  # -> Item, Item1, Item2
froce_kn_moment_kn_m = Panel(merge_3)
nodal_displacement_m_rad = Panel(shift_paths)
merge_4 = Merge(Data1=list_item.Item, Data2=list_item.Item1, Data3=list_item.Item2)
number = Number(merge_4)
square = Square(Value=number)
mass_addition = MassAddition(Input=square)  # -> Result, PartialResults
square_root = SquareRoot(Value=mass_addition.Result)  # -> flatten(Result)
sort_list = SortList(Keys=square_root)  # -> reverse(Keys), ValuesValuesA
elastic_energy_knm = ClusterOutput(analyze_karamba3d.ElasticEnergy_kNm)
calculated_model = ClusterOutput(analyze_karamba3d.CalculatedModel)
result = ClusterOutput(merge_3)
data = ClusterOutput(shift_paths)
result_2 = ClusterOutput(merge_2)
keys = ClusterOutput(sort_list.Keys)

# ==== cluster Cluster_3
curve = Curve()
model = ClusterInput()
entwine = Entwine(Branch00=curve, FlattenInputs=True)
# element id shower
c_script = CSharpScript(model=model, layers=entwine)  # -> out, A, edge_layer_list; inputs model: list of Curve, layers: tree of Curve
# ---------- c_script: C# usings ----------
using System.IO;
using System.Linq;
using System.Data;
using System.Drawing;
using System.Reflection;
using System.Windows.Forms;
using System.Xml;
using System.Xml.Linq;
using System.Runtime.InteropServices;

using Rhino.DocObjects;
using Rhino.Collections;
using GH_IO;
using GH_IO.Serialization;
# ---------- c_script: C# ----------
    DataTree<int> index_tree = new DataTree<int>();
    List<int> edge_layer = new List<int>(new int[model.Count()]);

    foreach(var path in layers.Paths)
    {
      foreach(var line in layers.Branch(path.Indices))
      {
        for(int i = 0; i < model.Count(); i++)
        {
          var compare_line = model[i];

          if(line.PointAt(0) == compare_line.PointAt(0))
          {
            if(line.PointAt(1) == compare_line.PointAt(1))
            {
              index_tree.Add(i, path);
              edge_layer[i] = path.Indices[0];
              //              GH_Path p = new GH_Path(0);
              //              p.Indices
              continue;
            }
          }

          if(line.PointAt(0) == compare_line.PointAt(1))
          {
            if(line.PointAt(1) == compare_line.PointAt(0))
            {
              index_tree.Add(i, path);
              edge_layer[i] = path.Indices[0];
              continue;
            }
          }
        }
      }
    }

    A = index_tree;
    edge_layer_list = edge_layer;
# ---------- end c_script ----------
list_item = ListItem(List=model, Index=c_script.A, Wrap=True)
panel = Panel(c_script.A)
ghpython_script = GhPythonScript(x=panel)  # -> out, a; inputs x: list
# ---------- ghpython_script: Python ----------
__author__ = "harry"
__version__ = "2019.08.22"

import rhinoscriptsyntax as rs

print([int(v) for v in x])
# ---------- end ghpython_script ----------

# ==== cluster Cluster_4
pts = ClusterInput()
target_pts = ClusterInput()
c_script = CSharpScript(pts=pts, target_pts=target_pts, dist_tol=0.001)  # -> out, A; inputs pts: list of Point3d, target_pts: list of Point3d, dist_tol: Double; disabled
# ---------- c_script: C# usings ----------
using System.IO;
using System.Linq;
using System.Data;
using System.Drawing;
using System.Reflection;
using System.Windows.Forms;
using System.Xml;
using System.Xml.Linq;
using System.Runtime.InteropServices;

using Rhino.DocObjects;
using Rhino.Collections;
using GH_IO;
using GH_IO.Serialization;
# ---------- c_script: C# ----------
    List<int> id = new List<int>();

    foreach(Point3d t_pt in target_pts)
    {
      for(int i = 0; i < pts.Count(); i++)
      {
        if(t_pt.DistanceTo(pts[i]) < dist_tol)
        {
          id.Add(i);
          break;
        }
      }
    }

    A = id;
# ---------- end c_script ----------
list = ClusterInput()
list_item = ListItem(List=list, Index=c_script.A, Wrap=True)  # disabled

# ==== cluster Cluster_5
frame_json_file_path = ClusterInput()
scale = ClusterInput()
ghpython_script = GhPythonScript(frame_json_file_path=frame_json_file_path, scale=scale)  # -> out, all_nodes, all_elements, simplify(all_element_node_ids), all_fix_node_ids, material_name, E, E_unit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
# ---------- ghpython_script: Python ----------
import rhinoscriptsyntax as rs
import Rhino.Geometry as rg
from Grasshopper import DataTree as datatree
from Grasshopper.Kernel.Data import GH_Path as ghpath
import System
import math

from ghpythonlib.treehelpers import list_to_tree, tree_to_list

import scriptcontext as sc
pyconmech = sc.sticky['pyconmech']
np = sc.sticky['numpy']

def rvector2list(rv):
    return [rv.X, rv.Y, rv.Z]

frame_info = pyconmech.frame_analysis.frame_file_io.read_frame_json(frame_json_file_path, verbose=True)

node_points, element_vids, fix_node_ids, fix_specs, model_type, material_dicts, model_name = frame_info

all_nodes = [rs.CreatePoint(scale*pt[0], scale*pt[1], scale*pt[2]) for pt in node_points]
all_elements = [rg.Line(all_nodes[n1], all_nodes[n2]) for n1, n2 in element_vids]

all_element_node_ids = list_to_tree(element_vids)
all_fix_node_ids = [int(v) for v in fix_node_ids]

material_name = material_dicts[0]['material_name']
E = material_dicts[0]['youngs_modulus']
E_unit = material_dicts[0]['youngs_modulus_unit']

G = material_dicts[0]['shear_modulus']
G_unit = material_dicts[0]['shear_modulus_unit']

if 'tensile_yeild_stress' in material_dicts[0]:
    sigma = material_dicts[0]['tensile_yeild_stress']
    sigma_unit = material_dicts[0]['tensile_yeild_stress_unit']

rho = material_dicts[0]['density']
rho_unit = material_dicts[0]['density_unit']

r = math.sqrt(material_dicts[0]['cross_sec_area'] / math.pi)
r_unit = 'centimeter'
# ---------- end ghpython_script ----------
data = Data(ghpython_script.G_unit)
data_2 = Data(ghpython_script.material_name)
data_3 = Data(ghpython_script.E)
data_4 = Data(ghpython_script.E_unit)
data_5 = Data(ghpython_script.G)
data_6 = Data(ghpython_script.r)
data_7 = Data(ghpython_script.sigma)
data_8 = Data(ghpython_script.rho)
data_9 = Data(ghpython_script.sigma_unit)
data_10 = Data(ghpython_script.rho_unit)
data_11 = Data(ghpython_script.r_unit)
panel = Panel(data_3)
panel_2 = Panel(data_5)
panel_3 = Panel(data_4)
panel_4 = Panel(data_11)
panel_5 = Panel(data_10)
panel_6 = Panel(data_2)
panel_7 = Panel(data)
panel_8 = Panel(data_7)
panel_9 = Panel(data_8)
panel_10 = Panel(data_9)
panel_11 = Panel(data_6)
material_properties_karamba3d = MaterialPropertiesKaramba3D(
    FamilyOfMaterial=panel_6,
    Name="0",
    YoungsModulus_kN_cm2=panel,
    InPlaneShearModulus_kN_cm2=panel_2,
    TransverseShearModulus_kN_cm2=panel_2,
    SpecificWeight_kN_m3=panel_9,
    CoefficientOfThermalExpansion_1_C=1e-05,
    YieldStrength_kN_cm2=Slider(23.5, range=0..100),
    mode="Isotrop")
all_nodes = ClusterOutput(ghpython_script.all_nodes)
all_element_node_ids = ClusterOutput(ghpython_script.all_element_node_ids)
all_elements = ClusterOutput(ghpython_script.all_elements)
all_fix_node_ids = ClusterOutput(ghpython_script.all_fix_node_ids)
radius = ClusterOutput(panel_11)  # radius
material = ClusterOutput(material_properties_karamba3d)

# ==== cluster Cluster
text = ClusterInput()
separators = ClusterInput()
text_split = TextSplit(Text=text, Separators=separators)
number = Number(text_split)
clean_tree = CleanTree(RemoveNulls=True, RemoveInvalid=True, RemoveEmpty=False, Tree=number)
tree = ClusterOutput(clean_tree)
